% Simulink data dictionary ButtonLogicData.sldd

ECU_SL_Status = Simulink.Parameter(0, DataType="uint8")
ECU_CC_Feature = Simulink.Parameter(0, DataType="uint8")
CCU_RCM_Feature = Simulink.Parameter(0, DataType="uint8")
CCU_RCM_Ready_Status = Simulink.Parameter(0, DataType="uint8")
ECU_SL_LED = Simulink.Parameter(0, DataType="uint8")
ECU_SL_Feature = Simulink.Parameter(0, DataType="uint8")
CCU_Status = Simulink.Parameter(eCCUStatus.installed, DataType="Enum: eCCUStatus")
CCU_TbT_Navigation_Feature = Simulink.Parameter(0, DataType="uint8")
CCU_Music_Feature = Simulink.Parameter(0, DataType="uint8")
heatingGrip = Simulink.Parameter(0, DataType="uint8")